# Dynamo graph merge beams (select all).dyn (Dynamo 2.18.1.5096)
# author: BVC
# This Script merges all model collinear Beams
# packages: Data-Shapes 2025.3.118

# group: Select Elements
select_beam_model_elements = DSModelElementsByCategorySelection("OST_StructuralFraming")  # 536 picked in the model; graph input
unjoinAllGeometry = Element.UnjoinAllGeometry(elements=select_beam_model_elements)
elementType = Element.ElementType(element=unjoinAllGeometry)
groupByKey = List.GroupByKey(list=unjoinAllGeometry, keys=elementType)
code_block = CodeBlock { true; "Run"; "Slide to run each beam group untill all beams merges"; }
code_block_2 = CodeBlock { 0; }
number_of_times_to_move_the = List.Count(list=groupByKey.uniqueKeys)  # "Number of times to move the slidder"
slider = Custom[Slider](Minimum=code_block_2, Maximum=number_of_times_to_move_the)  # package Data-Shapes; Creates slider input for UI.MultipleInputForm ++ . Set the step to decimal value if you want a double slider, or to a integer value if you want an integer slider.
multipleinputform = Custom[MultipleInputForm ++](Description_optional=code_block.out2, ButtonText_optional=code_block.out1, Inputs=slider, Toggle=code_block.out0)  # package Data-Shapes; Create a form with multiple inputs. see www.data-shapes.net for tutorials and infos!
code_block_3 = CodeBlock(x=multipleinputform.User_Inputs, y=number_of_times_to_move_the) { x<=y; }
filterByBoolMask = List.FilterByBoolMask(list=multipleinputform.User_Inputs, mask=code_block_3)
getItemAtIndex = List.GetItemAtIndex(list=groupByKey.groups, index=filterByBoolMask.in)
getItemAtIndex_2 = List.GetItemAtIndex(list=groupByKey.groups, index=filterByBoolMask.in)

# group: Getting Location
getLocation = Element.GetLocation(element=getItemAtIndex)
startPoint = Curve.StartPoint(curve=getLocation)
Z = Point.Z(point=startPoint)
groupByKey_2 = List.GroupByKey(list=getLocation@L2, keys=Z@L2)

# group: Grouping By X & Y Direction
direction = Line.Direction(line=groupByKey_2.groups)
Y = Vector.Y(vector=direction)
abs = Math.Abs(number=Y)
code_block_4 = CodeBlock { 230; }
code_block_5 = CodeBlock(lenght=abs, width=code_block_4) { lenght<width; }
filterByBoolMask_2 = List.FilterByBoolMask(list=groupByKey_2.groups@L2, mask=code_block_5@L2)

# group: Grouping By "Point Y"
startPoint_2 = Curve.StartPoint(curve=filterByBoolMask_2.in)
Y_2 = Point.Y(point=startPoint_2)
round = Math.Round(number=Y_2)
code_block_6 = CodeBlock(x=round) { x/100; }
floor = Math.Floor(number=code_block_6)
code_block_7 = CodeBlock(x=floor) { x*100; }
groupByKey_3 = List.GroupByKey(list=filterByBoolMask_2.in@L2, keys=code_block_7@L2)

# group: Sorting by Point X
startPoint_3 = Curve.StartPoint(curve=groupByKey_3.groups)
X = Point.X(point=startPoint_3)
sortByKey = List.SortByKey(list=groupByKey_3.groups@L2, keys=X@L2)

# group: Separating Beams
watch = Watch(sortByKey.sortedList)
count = List.Count(list=watch@L2)
code_block_8 = CodeBlock { 1; }
allIndicesOf = List.AllIndicesOf(list=count@L2, item=code_block_8)
removeItemAtIndex = List.RemoveItemAtIndex(list=watch, indices=allIndicesOf)
startPoint_4 = Curve.StartPoint(curve=removeItemAtIndex)
X_2 = Point.X(point=startPoint_4)
sortByKey_2 = List.SortByKey(list=startPoint_4@L2, keys=X_2@L2)
X_3 = Point.X(point=sortByKey_2.sortedList)
endPoint = Curve.EndPoint(curve=removeItemAtIndex)
X_4 = Point.X(point=endPoint)
sortByKey_3 = List.SortByKey(list=endPoint@L2, keys=X_4@L2)
X_5 = Point.X(point=sortByKey_3.sortedList)
lt = X_3 < X_5
if_ = RefactoredIf(test=lt@L1, true=sortByKey_2.sortedList@L1, false=sortByKey_3.sortedList@L1)
lt_2 = X_3 < X_5
if_2 = RefactoredIf(test=lt_2@L1, true=sortByKey_3.sortedList@L1, false=sortByKey_2.sortedList@L1)

# group: Grouping Start point coordinate by Y axis and droping the 1st start point
Y_3 = Point.Y(point=if_)
groupByKey_4 = List.GroupByKey(list=if_, keys=Y_3)
code_block_9 = CodeBlock { 1; -1; }
dropItems = List.DropItems(list=groupByKey_4.groups@L2, amount=code_block_9.out0)

# group: Grouping Start PNT by Y axis and droping 1st start point in gp
if_3 = RefactoredIf(test=lt@L1, true=X_3@L1, false=X_5@L1)
groupByKey_5 = List.GroupByKey(list=if_3, keys=Y_3)
code_block_10 = CodeBlock { 1; -1; }
dropItems_2 = List.DropItems(list=groupByKey_5.groups@L2, amount=code_block_10.out0)

# group: Gping End point coordinate by Y axis and droping last end point in gp
Y_4 = Point.Y(point=if_2)
groupByKey_6 = List.GroupByKey(list=if_2, keys=Y_4)
dropItems_3 = List.DropItems(list=groupByKey_6.groups@L2, amount=code_block_9.out1)

# group: Grouping End point by Y axis and droping last endpoint in gp
if_4 = RefactoredIf(test=lt_2@L1, true=X_5@L1, false=X_3@L1)
groupByKey_7 = List.GroupByKey(list=if_4, keys=Y_4)
dropItems_4 = List.DropItems(list=groupByKey_7.groups@L2, amount=code_block_10.out1)

# group: Checking where there are breaks / gaps in beams & If 1st & last beam have continuity
sub = dropItems_2 - dropItems_4
code_block_11 = CodeBlock { 100; }
lt_3 = sub < code_block_11
firstItem = List.FirstItem(list=lt_3@L2)
code_block_12 = CodeBlock { true; false; }
if_5 = RefactoredIf(test=firstItem, true=code_block_12.out0, false=code_block_12.out1)
code_block_13 = CodeBlock { 300; }
code_block_14 = CodeBlock { "empty"; }
if_6 = RefactoredIf(test=if_5, true=code_block_13, false=code_block_14)
addItemToFront = List.AddItemToFront(item=if_6@L1, list=sub@L2)
lt_4 = sub < code_block_11
lastItem = List.LastItem(list=lt_4@L2)
if_7 = RefactoredIf(test=lastItem, true=code_block_12.out0, false=code_block_12.out1)
if_8 = RefactoredIf(test=if_7, true=code_block_13, false=code_block_14)
addItemToEnd = List.AddItemToEnd(item=if_8@L1, list=sub@L2)

# group: Checking if the start and end beam have continuity
firstItem_2 = List.FirstItem(list=groupByKey_4.groups@L2)
Y_5 = Point.Y(point=firstItem_2)
groupByKey_8 = List.GroupByKey(list=firstItem_2, keys=Y_5)
code_block_15 = CodeBlock { "empty"; }
if_9 = RefactoredIf(test=firstItem@L1, true=groupByKey_8.groups@L1, false=code_block_15)
addItemToFront_2 = List.AddItemToFront(item=if_9@L1, list=dropItems@L2)
lastItem_2 = List.LastItem(list=groupByKey_6.groups@L2)
if_10 = RefactoredIf(test=lastItem@L1, true=lastItem_2@L1, false=code_block_15)
addItemToEnd_2 = List.AddItemToEnd(item=if_10@L1, list=dropItems_3@L2)

# group: Grouping Beams based on space / gaps inbtween (maximum distance inbetween = 100)
code_block_16 = CodeBlock { 100; }
lt_5 = addItemToFront < code_block_16
python_script = Python(IN[0]=addItemToFront_2, IN[1]=lt_5)  # CPython3
# ---------- python_script.python (28 lines) ----------
# Inputs
points_list = IN[0]  # Nested list of points (e.g., [[Point(X, Y, Z), ...], ...])
bool_list = IN[1]    # Nested list of Booleans (e.g., [[true, false, ...], ...])

# Function to group points at a single level
def group_points(points, bools):
    grouped_points = []  # List to store grouped points
    current_group = []   # Temporary storage for current group
    
    # Loop through the Boolean values and corresponding points
    for i, is_true in enumerate(bools):
        if not is_true:  # If the value is False, start a new group
            if current_group:  # Append existing group if it's not empty
                grouped_points.append(current_group)
            current_group = []  # Reset current group
        current_group.append(points[i])  # Add the current point
    
    # Append the last group if not empty
    if current_group:
        grouped_points.append(current_group)
    
    return grouped_points

# Process nested lists
result = [group_points(points, bools) for points, bools in zip(points_list, bool_list)]

# Output the grouped points
OUT = result
# ----------------------------------------
flatten = List.Flatten(list=python_script@L2)
count_2 = List.Count(list=python_script@L2)
code_block_17 = CodeBlock { 1; }
gt = count_2 > code_block_17
filterByBoolMask_3 = List.FilterByBoolMask(list=flatten, mask=gt)
string_from_object = FromObject(object=filterByBoolMask_3.in)
code_block_18 = CodeBlock { "empty"; }
contains = String.Contains(string=string_from_object, searchFor=code_block_18)
filterByBoolMask_4 = List.FilterByBoolMask(list=filterByBoolMask_3.in, mask=contains)
Z_2 = Point.Z(point=filterByBoolMask_4.out)
groupByKey_9 = List.GroupByKey(list=filterByBoolMask_4.out@L2, keys=Z_2@L2)
firstItem_3 = List.FirstItem(list=groupByKey_9.groups@L2)

# group: Grouping Beams based on space / gaps inbtween (maximum distance inbetween = 100)
code_block_19 = CodeBlock { 100; }
lt_6 = addItemToEnd < code_block_19
python_script_2 = Python(IN[0]=addItemToEnd_2, IN[1]=lt_6)  # CPython3
# ---------- python_script_2.python (23 lines) ----------
def group_points(points, bools):
    grouped_points = []  # List to store the groups
    current_group = []   # Temporary storage for the current group

    for i, condition in enumerate(bools):
        current_group.append(points[i])  # Add the current point to the group

        # End the group when we encounter a False or at the end of the list
        if not condition or i == len(bools) - 1:
            grouped_points.append(current_group)  # Save the group
            current_group = []  # Start a new group
    
    return grouped_points

# Inputs
points_list = IN[0]  # Nested list of points (e.g., [[Point(X, Y, Z), ...], ...])
bool_list = IN[1]    # Nested list of Booleans (e.g., [[True, False, ...], ...])

# Process each level of nested lists
result = [group_points(points, bools) for points, bools in zip(points_list, bool_list)]

# Output the grouped points
OUT = result
# ----------------------------------------
flatten_2 = List.Flatten(list=python_script_2@L2)
count_3 = List.Count(list=python_script_2@L2)
code_block_20 = CodeBlock { 1; }
gt_2 = count_3 > code_block_20
filterByBoolMask_5 = List.FilterByBoolMask(list=flatten_2, mask=gt_2)
string_from_object_2 = FromObject(object=filterByBoolMask_5.in)
code_block_21 = CodeBlock { "empty"; }
contains_2 = String.Contains(string=string_from_object_2, searchFor=code_block_21)
filterByBoolMask_6 = List.FilterByBoolMask(list=filterByBoolMask_5.in, mask=contains_2)
Z_3 = Point.Z(point=filterByBoolMask_6.out)
groupByKey_10 = List.GroupByKey(list=filterByBoolMask_6.out@L2, keys=Z_3@L2)
lastItem_3 = List.LastItem(list=groupByKey_10.groups@L2)

# group: Grouping Beam to Delete
watch_2 = Watch(getItemAtIndex)
flatten_3 = List.Flatten(list=watch_2)
watch_3 = Watch(getLocation)
flatten_4 = List.Flatten(list=watch_3)
byStartPointEndPoint = Line.ByStartPointEndPoint(startPoint=groupByKey_9.groups, endPoint=groupByKey_10.groups)
flatten_5 = List.Flatten(list=byStartPointEndPoint)
python_script_3 = Python(IN[0]=flatten_4, IN[1]=flatten_5)  # CPython3
# ---------- python_script_3.python (26 lines) ----------
import clr
clr.AddReference('ProtoGeometry')
from Autodesk.DesignScript.Geometry import *

# Inputs
curves_to_check = IN[0]  # First list of curves
reference_curves = IN[1]  # Second list of curves to check against

# Function to compare two curves based on their start and end points
def are_curves_equal(curve1, curve2):
    return (curve1.StartPoint.IsAlmostEqualTo(curve2.StartPoint) and curve1.EndPoint.IsAlmostEqualTo(curve2.EndPoint)) or \
           (curve1.StartPoint.IsAlmostEqualTo(curve2.EndPoint) and curve1.EndPoint.IsAlmostEqualTo(curve2.StartPoint))

# Check if each curve in curves_to_check exists in reference_curves
def check_curves_in_list(curves_to_check, reference_curves):
    result = []
    for curve in curves_to_check:
        is_contained = any(are_curves_equal(curve, ref_curve) for ref_curve in reference_curves)
        result.append(is_contained)
    return result

# Execute the function
result = check_curves_in_list(curves_to_check, reference_curves)

# Output: A list of True/False values for each curve in curves_to_check
OUT = result
# ----------------------------------------
filterByBoolMask_7 = List.FilterByBoolMask(list=flatten_3@L2, mask=python_script_3@L2)

# group: Grouping By "Point X"
startPoint_5 = Curve.StartPoint(curve=filterByBoolMask_2.out)
X_6 = Point.X(point=startPoint_5)
round_2 = Math.Round(number=X_6)
code_block_22 = CodeBlock(x=round_2) { x/100; }
floor_2 = Math.Floor(number=code_block_22)
code_block_23 = CodeBlock(x=floor_2) { x*100; }
groupByKey_11 = List.GroupByKey(list=filterByBoolMask_2.out@L2, keys=code_block_23@L2)

# group: Sorting by Point Y
startPoint_6 = Curve.StartPoint(curve=groupByKey_11.groups)
Y_6 = Point.Y(point=startPoint_6)
sortByKey_4 = List.SortByKey(list=groupByKey_11.groups@L2, keys=Y_6@L2)

# group: Separating Beams
watch_4 = Watch(sortByKey_4.sortedList)
count_4 = List.Count(list=watch_4@L2)
code_block_24 = CodeBlock { 1; }
allIndicesOf_2 = List.AllIndicesOf(list=count_4@L2, item=code_block_24)
removeItemAtIndex_2 = List.RemoveItemAtIndex(list=watch_4, indices=allIndicesOf_2)
startPoint_7 = Curve.StartPoint(curve=removeItemAtIndex_2)
Y_7 = Point.Y(point=startPoint_7)
sortByKey_5 = List.SortByKey(list=startPoint_7@L2, keys=Y_7@L2)
Y_8 = Point.Y(point=sortByKey_5.sortedList)
endPoint_2 = Curve.EndPoint(curve=removeItemAtIndex_2)
Y_9 = Point.Y(point=endPoint_2)
sortByKey_6 = List.SortByKey(list=endPoint_2@L2, keys=Y_9@L2)
Y_10 = Point.Y(point=sortByKey_6.sortedList)
lt_7 = Y_8 < Y_10
if_11 = RefactoredIf(test=lt_7@L1, true=sortByKey_5.sortedList@L1, false=sortByKey_6.sortedList@L1)
lt_8 = Y_8 < Y_10
if_12 = RefactoredIf(test=lt_8@L1, true=sortByKey_6.sortedList@L1, false=sortByKey_5.sortedList@L1)

# group: Grouping Start point coordinate by X axis and droping the 1st start point
X_7 = Point.X(point=if_11)
groupByKey_12 = List.GroupByKey(list=if_11, keys=X_7)
code_block_25 = CodeBlock { 1; -1; }
dropItems_5 = List.DropItems(list=groupByKey_12.groups@L2, amount=code_block_25.out0)

# group: Grouping Start PNT by X axis and droping 1st start point in gp
if_13 = RefactoredIf(test=lt_7@L1, true=Y_8@L1, false=Y_10@L1)
groupByKey_13 = List.GroupByKey(list=if_13, keys=X_7)
code_block_26 = CodeBlock { 1; -1; }
dropItems_6 = List.DropItems(list=groupByKey_13.groups@L2, amount=code_block_26.out0)

# group: Gping End point coordinate by X axis and droping last end point in gp
X_8 = Point.X(point=if_12)
groupByKey_14 = List.GroupByKey(list=if_12, keys=X_8)
dropItems_7 = List.DropItems(list=groupByKey_14.groups@L2, amount=code_block_25.out1)

# group: Grouping End point by X axis and droping last endpoint in gp
if_14 = RefactoredIf(test=lt_8@L1, true=Y_10@L1, false=Y_8@L1)
groupByKey_15 = List.GroupByKey(list=if_14, keys=X_8)
dropItems_8 = List.DropItems(list=groupByKey_15.groups@L2, amount=code_block_26.out1)

# group: Checking where there are breaks / gaps in beams & If 1st & last beam have continuity
sub_2 = dropItems_6 - dropItems_8
code_block_27 = CodeBlock { 100; }
lt_9 = sub_2 < code_block_27
firstItem_4 = List.FirstItem(list=lt_9@L2)
code_block_28 = CodeBlock { true; false; }
if_15 = RefactoredIf(test=firstItem_4, true=code_block_28.out0, false=code_block_28.out1)
code_block_29 = CodeBlock { 300; }
code_block_30 = CodeBlock { "empty"; }
if_16 = RefactoredIf(test=if_15, true=code_block_29, false=code_block_30)
addItemToFront_3 = List.AddItemToFront(item=if_16@L1, list=sub_2@L2)
lt_10 = sub_2 < code_block_27
lastItem_4 = List.LastItem(list=lt_10@L2)
if_17 = RefactoredIf(test=lastItem_4, true=code_block_28.out0, false=code_block_28.out1)
if_18 = RefactoredIf(test=if_17, true=code_block_29, false=code_block_30)
addItemToEnd_3 = List.AddItemToEnd(item=if_18@L1, list=sub_2@L2)

# group: Checking if the start and end beam have continuity
firstItem_5 = List.FirstItem(list=groupByKey_12.groups@L2)
X_9 = Point.X(point=firstItem_5)
groupByKey_16 = List.GroupByKey(list=firstItem_5, keys=X_9)
code_block_31 = CodeBlock { "empty"; }
if_19 = RefactoredIf(test=firstItem_4@L1, true=groupByKey_16.groups@L1, false=code_block_31)
addItemToFront_4 = List.AddItemToFront(item=if_19@L1, list=dropItems_5@L2)
lastItem_5 = List.LastItem(list=groupByKey_14.groups@L2)
if_20 = RefactoredIf(test=lastItem_4@L1, true=lastItem_5@L1, false=code_block_31)
addItemToEnd_4 = List.AddItemToEnd(item=if_20@L1, list=dropItems_7@L2)

# group: Grouping Beams based on space / gaps inbtween (maximum distance inbetween = 100)
code_block_32 = CodeBlock { 100; }
lt_11 = addItemToFront_3 < code_block_32
python_script_4 = Python(IN[0]=addItemToFront_4, IN[1]=lt_11)  # CPython3; same code as python_script
flatten_6 = List.Flatten(list=python_script_4@L2)
count_5 = List.Count(list=python_script_4@L2)
code_block_33 = CodeBlock { 1; }
gt_3 = count_5 > code_block_33
filterByBoolMask_8 = List.FilterByBoolMask(list=flatten_6, mask=gt_3)
string_from_object_3 = FromObject(object=filterByBoolMask_8.in)
code_block_34 = CodeBlock { "empty"; }
contains_3 = String.Contains(string=string_from_object_3, searchFor=code_block_34)
filterByBoolMask_9 = List.FilterByBoolMask(list=filterByBoolMask_8.in, mask=contains_3)
Z_4 = Point.Z(point=filterByBoolMask_9.out)
groupByKey_17 = List.GroupByKey(list=filterByBoolMask_9.out@L2, keys=Z_4@L2)
firstItem_6 = List.FirstItem(list=groupByKey_17.groups@L2)

# group: Grouping Beams based on space / gaps inbtween (maximum distance inbetween = 100)
code_block_35 = CodeBlock { 100; }
lt_12 = addItemToEnd_3 < code_block_35
python_script_5 = Python(IN[0]=addItemToEnd_4, IN[1]=lt_12)  # CPython3; same code as python_script_2
flatten_7 = List.Flatten(list=python_script_5@L2)
count_6 = List.Count(list=python_script_5@L2)
code_block_36 = CodeBlock { 1; }
gt_4 = count_6 > code_block_36
filterByBoolMask_10 = List.FilterByBoolMask(list=flatten_7, mask=gt_4)
string_from_object_4 = FromObject(object=filterByBoolMask_10.in)
code_block_37 = CodeBlock { "empty"; }
contains_4 = String.Contains(string=string_from_object_4, searchFor=code_block_37)
filterByBoolMask_11 = List.FilterByBoolMask(list=filterByBoolMask_10.in, mask=contains_4)
Z_5 = Point.Z(point=filterByBoolMask_11.out)
groupByKey_18 = List.GroupByKey(list=filterByBoolMask_11.out@L2, keys=Z_5@L2)
lastItem_6 = List.LastItem(list=groupByKey_18.groups@L2)

# group: Grouping Beam to Delete
watch_5 = Watch(getLocation)
flatten_8 = List.Flatten(list=watch_5)
byStartPointEndPoint_2 = Line.ByStartPointEndPoint(startPoint=groupByKey_17.groups, endPoint=groupByKey_18.groups)
flatten_9 = List.Flatten(list=byStartPointEndPoint_2)
python_script_6 = Python(IN[0]=flatten_8, IN[1]=flatten_9)  # CPython3; same code as python_script_3
filterByBoolMask_12 = List.FilterByBoolMask(list=getItemAtIndex@L2, mask=python_script_6)

# group: Joining Point to form curve
byStartPointEndPoint_3 = Line.ByStartPointEndPoint(startPoint=firstItem_3, endPoint=lastItem_3)
byStartPointEndPoint_4 = Line.ByStartPointEndPoint(startPoint=firstItem_6, endPoint=lastItem_6)

# group: Creating Beam Types
firstItem_7 = List.FirstItem(list=getItemAtIndex_2@L2)
code_block_38 = CodeBlock { "Reference Level"; }
getParameterValueByName = Element.GetParameterValueByName(element=firstItem_7, parameterName=code_block_38)
elementType_2 = Element.ElementType(element=firstItem_7)

# group: Creating Beam Types
firstItem_8 = List.FirstItem(list=getItemAtIndex_2@L2)
code_block_39 = CodeBlock { "Reference Level"; }
getParameterValueByName_2 = Element.GetParameterValueByName(element=firstItem_8, parameterName=code_block_39)
elementType_3 = Element.ElementType(element=firstItem_8)

# group: Creating the Beam
beamByCurve = StructuralFraming.BeamByCurve(curve=byStartPointEndPoint_3, level=getParameterValueByName, structuralFramingType=elementType_2, lacing=Longest)
beamByCurve_2 = StructuralFraming.BeamByCurve(curve=byStartPointEndPoint_4, level=getParameterValueByName_2, structuralFramingType=elementType_3, lacing=Longest)
list_create = List.Create(item0=beamByCurve, item1=beamByCurve_2)
unjoinAllGeometry_2 = Element.UnjoinAllGeometry(elements=list_create)

# group: Beam Justification
code_block_40 = CodeBlock { false; }
clean = List.Clean(list=unjoinAllGeometry_2, preserveIndices=code_block_40)
code_block_41 = CodeBlock { "z Justification"; }
getParameterValueByName_3 = Element.GetParameterValueByName(element=firstItem_7, parameterName=code_block_41)
setParameterByName = Element.SetParameterByName(element=clean, parameterName=code_block_41, value=getParameterValueByName_3)
unjoinAllGeometry_3 = Element.UnjoinAllGeometry(elements=setParameterByName)

# group: Deleting Beams
join = List.Join(list0=filterByBoolMask_7.in, list1=filterByBoolMask_12.in)
code_block_42 = CodeBlock(data=join, waitfor=setParameterByName) { [data,waitfor][0]; }
delete = Element.Delete(element=code_block_42)
